test file "Transmission_Test_Suite"

suite "10-Speed Transmission Controller"

  case "ETRS 3" [baseline]
    model TransmissionControl, mode Normal, start time 0, stop time 65
    assessment "ETRS 3.1": At any point of time, whenever DriveRangeSelector == Park & VehicleSpeed <= 0.1 is true then, with no delay, GearCommanded == 0 must be true
      GearCommanded: signal TransmissionControl/Transmission Controller, port 2
      DriveRangeSelector: signal TransmissionControl/Variant Source2, port 1
      VehicleSpeed: signal TransmissionControl/LongitudinalVehiclePlant, port 3
      Park: expression RangeSelected.Park

  case "ETRS 4" [simulation]
    model TransmissionControl, variant configuration Test
    input "ETRS_0-60Log.mat", mapped to DriverBrake, DriverThrottle, DriverGearSelection (active)
    assessment "ETRS 4": At any point of time, if VehSpd > 0.1 becomes true then, with a delay of at most 12, VehSpd > 60 must be true
      VehSpd: signal TransmissionControl/Signal Specification, port 1

suite "Neutral, Park, Drive, Reverse Logic Tests"

  case "ParkingCommandFromStill_in_r2.1r3.1r7_test1" [baseline]
    model TransmissionController, mode Normal, start time 0, stop time 30
    input "ParkingCommand_in_r2.1_test1.mat", mapped to DriverBrake, DriverThrottle, Driver Range Selection, Vehicle Speed, Engine Speed, EngPwrOutput (active)
    assessment "ParkingCommand_in_r2.1_test1": At any point of time, if abs(vehicleSpeed) < 0.1 & rangeSelected == Park becomes true then, with a delay of at most 0.1, ParkingBrakeCommand & GearCommand == 0 must be true
      ParkingBrakeCommand: signal TransmissionController/Merge1, port 1
      rangeSelected: signal TransmissionController/Driver Range Selection, port 1
      vehicleSpeed: signal TransmissionController/Vehicle Speed, port 1
      Park: expression RangeSelected.Park
      GearCommand: signal TransmissionController/Merge, port 1

  case "ParkingCommandFromReverse_in_r2.1_test1" [baseline]
    model TransmissionController, mode Normal, start time 0, stop time 30
    input "ParkingCommandFromReverse_in_r2.1_test1.mat", mapped to DriverBrake, DriverThrottle, Driver Range Selection, Vehicle Speed, Engine Speed, EngPwrOutput (active)
    assessment "Assessment1": At any point of time, whenever rangeSelected == Park & abs(vehicleSpeed) > 0.1 is true then, with a delay of at most 1, ~ParkingBrakeCommand must be true
      rangeSelected: signal TransmissionController/Driver Range Selection, port 1
      Park: expression RangeSelected.Park
      vehicleSpeed: signal TransmissionController/Vehicle Speed, port 1
      ParkingBrakeCommand: signal TransmissionController/Merge1, port 1

  case "ParkingCommandFromDrive_in_r2.1_test2" [baseline]
    model TransmissionController, start time 0, stop time 30
    input "ParkingCommandFromDrive_in_r2.1_test2.mat", mapped to DriverBrake, DriverThrottle, Driver Range Selection, Vehicle Speed, Engine Speed, EngPwrOutput (active)
    assessment "Assessment1": At any point of time, whenever rangeSelected == Park & abs(vehicleSpeed) > 0.1 is true then, with a delay of at most 1, ~ParkingBrakeCommand must be true
      rangeSelected: signal TransmissionController/Driver Range Selection, port 1
      Park: expression RangeSelected.Park
      ParkingBrakeCommand: signal TransmissionController/Merge1, port 1
      vehicleSpeed: signal TransmissionController/Vehicle Speed, port 1

  case "ParkingCommandFromReverse_in_r2.1_test3" [baseline]
    model TransmissionController, mode Normal, start time 0, stop time 30
    input "ParkingCommandFromReverse_in_r2.1_test3.mat", mapped to DriverBrake, DriverThrottle, Driver Range Selection, Vehicle Speed, Engine Speed, EngPwrOutput (active)
    assessment "Assessment1": At any point of time, whenever rangeSelected == Park & abs(vehicleSpeed) < 0.1 is true then, with a delay of at most 0.1, ParkingBrakeCommand must be true
      rangeSelected: signal TransmissionController/Driver Range Selection, port 1
      Park: expression RangeSelected.Park
      vehicleSpeed: signal TransmissionController/Vehicle Speed, port 1
      ParkingBrakeCommand: signal TransmissionController/Merge1, port 1

  case "ParkingCommandFromDrive_in_r2.1_test4" [baseline]
    model TransmissionController, start time 0, stop time 30
    input "ParkingCommandFromDrive_in_r2.1_test4.mat", mapped to DriverBrake, DriverThrottle, Driver Range Selection, Vehicle Speed, Engine Speed, EngPwrOutput (active)
    assessment "Assessment1": At any point of time, whenever rangeSelected == Park & abs(vehicleSpeed) < 0.1 is true then, with a delay of at most 0.1, ParkingBrakeCommand must be true
      rangeSelected: signal TransmissionController/Driver Range Selection, port 1
      Park: expression RangeSelected.Park
      ParkingBrakeCommand: signal TransmissionController/Merge1, port 1
      vehicleSpeed: signal TransmissionController/Vehicle Speed, port 1

  case "NeutralGearCommandFromDrive_in_r2.4_test1" [baseline]
    model TransmissionController, mode Normal, start time 0, stop time 30
    input "NeutralGearCommandFromDrive.mat", mapped to DriverBrake, DriverThrottle, Driver Range Selection, Vehicle Speed, Engine Speed, EngPwrOutput (active)
    assessment "Assessment1": At any point of time, whenever rangeSelected == Neutral is true then, with a delay of at most 0.01, GearCommand == 0 must be true
      rangeSelected: signal TransmissionController/Driver Range Selection, port 1
      Neutral: expression RangeSelected.Neutral
      GearCommand: signal TransmissionController/Merge, port 1

  case "NeutralGearCommandFromReverse_in_r2.4_test2" [baseline]
    model TransmissionController, mode Normal, start time 0, stop time 30
    input "NeutralGearCommandFromReverse.mat", mapped to DriverBrake, DriverThrottle, Driver Range Selection, Vehicle Speed, Engine Speed, EngPwrOutput (active)
    assessment "Assessment1": At any point of time, whenever rangeSelected == Neutral is true then, with a delay of at most 0.01, GearCommand == 0 must be true
      rangeSelected: signal TransmissionController/Driver Range Selection, port 1
      Neutral: expression RangeSelected.Neutral
      GearCommand: signal TransmissionController/Merge, port 1

  case "ReverseToDrive_in_r2.2_test1" [baseline]
    model TransmissionController, mode Normal, start time 0, stop time 30
    input "ReverseToDrive_in_r2.2_test1.mat", mapped to DriverBrake, DriverThrottle, Driver Range Selection, Vehicle Speed, Engine Speed, EngPwrOutput (active)
    assessment "Assessment1": At any point of time, whenever vehicleSpeed > -0.5 & rangeSelection == Drive is true then, with no delay, GearCommand >= 1 & GearCommand <= 10 must stay true for at most 6
      vehicleSpeed: signal TransmissionController/Vehicle Speed, port 1
      rangeSelection: signal TransmissionController/Driver Range Selection, port 1
      Drive: expression RangeSelected.Drive
      GearCommand: signal TransmissionController/Merge, port 1

  case "DriveToReverse_in_r2.3_test1" [baseline]
    model TransmissionController, mode Normal, start time 0, stop time 30
    input "DriveToReverse_in_r2.2_test1.mat", mapped to DriverBrake, DriverThrottle, Driver Range Selection, Vehicle Speed, Engine Speed, EngPwrOutput (active)
    assessment "Assessment1": At any point of time, whenever vehicleSpeed < 0.5 & rangeSelection == Reverse is true then, with a delay of at most 0.1, GearCommand == -1 must stay true for at most 6
      vehicleSpeed: signal TransmissionController/Vehicle Speed, port 1
      rangeSelection: signal TransmissionController/Driver Range Selection, port 1
      GearCommand: signal TransmissionController/Merge, port 1
      Reverse: expression RangeSelected.Reverse

  case "OpenParkingActuator_in_r7.2_test1" [baseline]
    model TransmissionController, mode Normal, start time 0, stop time 30
    input "NeutralGearCommandFromDrive.mat", mapped to DriverBrake, DriverThrottle, Driver Range Selection, Vehicle Speed, Engine Speed, EngPwrOutput (active)
    assessment "Assessment1": At any point of time, whenever rangeSelection == Park is true then, with a delay of at most 0.1, ParkingGearCommand == true must be true
      rangeSelection: signal TransmissionController/Driver Range Selection, port 1
      Park: expression RangeSelected.Park
      ParkingGearCommand: signal TransmissionController/Merge1, port 1